# Dynamo custom node Mesh.Create.MeshFromPoints.dyf "MeshFromPoints" (Dynamo 2.9.0.2536)
# category: DynFreeCAD.Mesh.Create
# Create a FreeCAD Mesh from a list of list of 3 Dynamo points. See example file and wiki for more info!

FreeCADDocument = Input(FreeCADDocument: System.Object)
points = Input(points: var[]..[])
python_script = Python(IN[0]=FreeCADDocument, IN[1]=points)  # CPython3
# ---------- python_script.python (16 lines) ----------
import FreeCAD
import Mesh

doc = IN[0]
pointlist = IN[1]
triangles = []


for tri in pointlist:
    for p in tri:
        triangles.append([p.X, p.Y, p.Z])
        
obj = doc.addObject("Mesh::Feature", "")
obj.Mesh = Mesh.Mesh(triangles)

OUT = obj
# ----------------------------------------
FreeCADMeshObject = Output(python_script)  # "FreeCADMeshObject:System.Object"
