# Dynamo custom node NewDocument.dyf (Dynamo 2.9.0.2476)
# category: DynFreeCAD.Document
# Create new document in FreeCAD

FreeCADModule = Input(FreeCADModule: var[]..[])
name = Input(name: string = None)
run = Input(run: bool = true)
python_script = Python(IN[0]=FreeCADModule, IN[1]=name, IN[2]=run)  # CPython3
# ---------- python_script.python (9 lines) ----------
docName = IN[1]
FreeCAD = IN[0]

if docName==None:
	doc = FreeCAD.newDocument()
else:
	doc = FreeCAD.newDocument(docName)

OUT = doc
# ----------------------------------------
FreeCADDocument = Output(python_script)
