# Dynamo custom node Part.ShapeFromMesh.Create.dyf "ShapeFromMesh" (Dynamo 2.9.0.2536)
# category: DynFreeCAD.Part.Create
# Create a FreeCAD Part from a FreeCAD Mesh

FreeCADDocument = Input(FreeCADDocument: System.Object)
FreeCADMeshObject = Input(FreeCADMeshObject: System.Object)
tolerance = Input(tolerance: double = 0.1)
python_script = Python(IN[0]=FreeCADDocument, IN[1]=FreeCADMeshObject, IN[2]=tolerance)  # CPython3
# ---------- python_script.python (13 lines) ----------
import FreeCAD, Mesh, Part

doc = IN[0]
mesh_obj = IN[1]
tolerance = IN[2]

part_obj = doc.addObject("Part::Feature","")
shape = Part.Shape()
shape.makeShapeFromMesh(mesh_obj.Mesh.Topology, tolerance)
part_obj.Shape = shape
del shape

OUT = part_obj
# ----------------------------------------
FreeCADPartObject = Output(python_script)  # "FreeCADPartObject:System.Object"
