# Dynamo graph ManageDocuments.dyn (Dynamo 2.9.0.2476)

file_path = Filename("E:\_PortableApps\FreeCAD\FreeCAD-conda-PY3.8\data\examples\ArchDetail.FCStd")
directory_path = Directory("E:\_PortableApps\FreeCAD\FreeCAD-conda-PY3.8\bin")
initialize = Custom[Initialize](FreeCADBinPath=directory_path)  # Initialize FreeCAD api and FreeCAD version info
openDocument = Custom[OpenDocument](filePath=file_path, FreeCADModule=initialize.FreeCADModule)  # Open a document in FreeCAD
newDocument = Custom[NewDocument](FreeCADModule=initialize.FreeCADModule)  # Create new document in FreeCAD
boolean = BoolSelector(true)
listDocuments = Custom[ListDocuments](reload=boolean)  # List all open FreeCAD documents
keys = DesignScript.Builtin.Dictionary.Keys(dictionary=listDocuments)
code_block = CodeBlock { 1; }
getItemAtIndex = List.GetItemAtIndex(list=keys, index=code_block)
valueAtKey = DesignScript.Builtin.Dictionary.ValueAtKey(dictionary=listDocuments, key=getItemAtIndex)
setActiveDocument = Custom[SetActiveDocument](FreeCADDocument=valueAtKey)  # Set active FreeCAD document
file_path_2 = Filename("C:\Users\gyetpet\Desktop\test.FCStd")
activeDocument = Custom[ActiveDocument](reload=boolean)  # Get active FreeCAD document
saveAs = Custom[SaveAs](path=file_path_2, FreeCADDocument=activeDocument)  # Save FreeCAD document to a path
fileName = Custom[FileName](FreeCADDocument=valueAtKey)  # Full path including filename of a FreeCAD document
saveAs_2 = Custom[SaveAs](path=fileName, FreeCADDocument=valueAtKey)
closeDocument = Custom[CloseDocument](FreeCADDocument=valueAtKey)  # Close an open FreeCAD document
name = Custom[Name](FreeCADDocument=activeDocument)  # Returns the name of a FreeCAD document
boolean_2 = BoolSelector(true)
closeAllDocuments = Custom[CloseAllDocuments](run=boolean_2)  # Close all open FreeCAD documents
