# Dynamo graph MoveRotatePartCubes.dyn "MoveRotatePartCubes.DYN" (Dynamo 2.9.0.2591)

# group: New FreeCAD Document
directory_path = Directory("E:\FreeCAD-conda-PY3.8-site_packages1\bin")
newDocument = Custom[NewDocument](FreeCADBinPath=directory_path)  # Create new document in FreeCAD

# group: Create 10 cubes
code_block = CodeBlock { 10; }
cycle = List.Cycle(list=newDocument.FreeCADDocument, amount=code_block)
cube = Custom[Cube](FreeCADDocument=cycle)  # Add a FreeCAD Part Cube/Box to the document

# group: Move Cubes
code_block_2 = CodeBlock(a=cube.FreeCADDocument) { a[0]; }
listAllObjects = Custom[ListAllObjects](FreeCADDocument=code_block_2)  # List all objects from a FreeCAD document
code_block_3 = CodeBlock { 1000; 0; }
byCoordinates = Vector.ByCoordinates(x=code_block_3.out0, y=code_block_3.out1, z=code_block_3.out1)
moveByVector = Custom[MoveByVector](FreeCADObject=listAllObjects.FreeCADObjects, vector=byCoordinates)  # Move a FreeCAD object by a Dynamo vector

# group: Rotate Cubes
ZAxis = Vector.ZAxis()
origin = Point.Origin()
code_block_4 = CodeBlock { 0..360..#10; }
rotateByVectorAndPoint = Custom[RotateByVectorAndPoint](vector=ZAxis, FreeCADObject=moveByVector, point=origin, degree=code_block_4)  # Rotate a FreeCAD object by a Dynamo vector and a dynamo Point

# group: Check placement
placement = Custom[Placement](FreeCADObject=rotateByVectorAndPoint)  # Returns the placement of a FreeCAD object

# group: Save FreeCAD Document
file_path = Filename("E:\RotatedCubes.FCStd")
code_block_5 = CodeBlock(a=rotateByVectorAndPoint) { a[0]; }
document = Custom[Document](FreeCADObject=code_block_5)  # Get the FreeCAD document of an object
saveAs = Custom[SaveAs](path=file_path, FreeCADDocument=document)  # Save FreeCAD document to a path
