# Dynamo graph QueryData.dyn (Dynamo 2.9.0.2476)

file_path = Filename("E:\Nextcloud\BIM-CAFM-CAD\freecad\Part Test.FCStd")
directory_path = Directory("E:\_PortableApps\FreeCAD\FreeCAD-conda-PY3.8-site_packages1\bin")
initialize = Custom[Initialize](FreeCADBinPath=directory_path)  # Initialize FreeCAD api and FreeCAD version info
openDocument = Custom[OpenDocument](filePath=file_path, FreeCADModule=initialize.FreeCADModule)  # Open a document in FreeCAD
findAllObjects = Custom[FindAllObjects](FreeCADDocument=openDocument)  # find FreeCAD objects in a document by specified type, name or label. All parameters are optional.
listAllObjects = Custom[ListAllObjects](FreeCADDocument=openDocument)  # List all objects from a FreeCAD document
code_block = CodeBlock { "Group"; }
getObjectByName = Custom[GetObjectByName](FreeCADDocument=openDocument, objectName=code_block)  # Get object in a FreeCAD document by name
objects = Custom[Objects](FreeCADGroup=getObjectByName)  # List objects in a FreeCAD group
code_block_2 = CodeBlock { "Box"; }
getObjectByName_2 = Custom[GetObjectByName](FreeCADDocument=openDocument, objectName=code_block_2)
properties = Custom[Properties](FreeCADObject=getObjectByName_2)  # Properties of a FreeCAD object
ID = Custom[ID](FreeCADObject=getObjectByName_2)  # Get the ID of a FreeCAD object
label = Custom[Label](FreeCADObject=getObjectByName_2)  # The label of a FreeCAD object
name = Custom[Name](FreeCADObject=getObjectByName_2)  # Name of a FreeCAD object
code_block_3 = CodeBlock { "Label"; "SmallCube2"; }
setPropertyByName = Custom[SetPropertyByName](FreeCADObject=getObjectByName_2, propertyName=code_block_3.out0, propertyValue=code_block_3.out1)  # Set a property of a FreeCAD object by name
