# Dynamo custom node ListDocuments.dyf (Dynamo 2.8.0.2327)
# category: DynFreeCAD.Document
# List all open FreeCAD documents

Run = Input(Run: bool = true)
python_script = Python(IN[0]=Run)  # CPython3
# ---------- python_script.python (5 lines) ----------
import FreeCAD

list_docs_dict = FreeCAD.listDocuments()

OUT = list_docs_dict
# ----------------------------------------
FreeCADDocuments = Output(python_script)
