# Dynamo custom node SaveAs.dyf (Dynamo 2.7.0.9206)
# category: DynFreeCAD.Document
# Save FreeCAD document to a path

Path = Input(Path: string)
python_script = Python(IN[0]=Path)  # CPython3
# ---------- python_script.python (9 lines) ----------
# import
import clr
import FreeCAD

docPath = IN[0]

FreeCAD.ActiveDocument.saveAs(docPath)

OUT = docPath
# ----------------------------------------
activeDocumentName = Output(python_script)
