# Dynamo custom node SetActiveDocument.dyf (Dynamo 2.7.0.9206)
# category: DynFreeCAD.Document
# Set active FreeCAD document

DocumentName = Input(DocumentName: string)
python_script = Python(IN[0]=DocumentName)  # CPython3
# ---------- python_script.python (13 lines) ----------
# import
import clr
import FreeCAD

docName = IN[0]

FreeCAD.setActiveDocument(docName)


ad = FreeCAD.ActiveDocument.Name


OUT = ad
# ----------------------------------------
activeDocumentName = Output(python_script)
